# Dynamo graph IfcLoad-PSetRemoval-Save.dyn (Dynamo 2.6.0.8481)
# packages: TRexIfc 0.1.0.0

file_path = Filename("Ifc4\IfcSampleHouse.ifc")
file_path_2 = Filename("Out\IfcLoad-PSetRemoval-Save.log")
file_logger = FileLog(fileName=file_path_2, LogEventLevel=1)
ifc_load = IfcLoadStoreNodeModel(fileName=file_path, logger=file_logger, IsCancelable=true)  # unwired: prefs
propertySetNames = Store.IfcModel.PropertySetNames(ifcModel=ifc_load)
exclude_items_from = ExcludingItemListNodeModel(items=propertySetNames, SelectedValue=["Identity Data"])
ifc_authormetadata = IfcAuthorMetadataNodeModel(OrganisationId="Self employed", OrganisationName="The unknown", AuthorName="Nobody", AuthorGivenName="Mr", OrganisationAddress="Somewhere")
workflow_name = CodeBlock { "PSetClean"; }
log_reason = LogReasonComposingNodeModel(Selected=[16, 32, 64])
ifc_pset_removal = IfcPSetRemovalTransformNodeModel(removePSetNames=exclude_items_from, authorMetadata=ifc_authormetadata, canonicalName=workflow_name, ifcModel=ifc_load, logReasonFilter=log_reason, IsCancelable=true)
directory_path = Directory("C:\Workspace\Git\BitubTRexDynamo\Examples\Out")
relocatePath = Store.IfcModel.RelocatePath(ifcModel=ifc_pset_removal, newPathName=directory_path)
code_block = CodeBlock { "-"; }
ifc_save = IfcSaveStoreNodeModel(ifcModel=relocatePath, separator=code_block, SelectedOption="ifczip", IsCancelable=true)
log_filter = LogFilterNodeModel(logSource=ifc_pset_removal, LogCount=55, LogMinSeverity=0)  # unwired: logReason
data_preview = DataTablePreviewNodeModel(in=log_filter, MinCount=1, MaxCount=100, Count=19)
