# Dynamo graph IfcLoad-SceneExport.dyn (Dynamo 2.6.1.8786)
# packages: TRexIfc 1.0.20304.44022, TRexIfc 1.0.20329.35171

# group: File logger
file_path = Filename("Out\IfcLoad-SceneExport.log")
file_logger = FileLog(fileName=file_path, LogEventLevel=1)

# group: LOad IFC
file_path_2 = Filename("Ifc4\IfcSampleHouse.ifc")
ifc_load = IfcLoadStoreNodeModel(fileName=file_path_2, logger=file_logger, IsCancelable=true)  # unwired: prefs

# group: Feature-2-classification filter
code_block = CodeBlock { "Other"; "Category"; }
byNames = Data.Canonical.ByNames(namePar0=code_block.out0, namePart1=code_block.out1)
canonical_filter = CanonicalFilterNodeModel(canonicals=byNames, MatchType=0)

# group: Export IFC as scene model using "Body" context
code_block_2 = CodeBlock { 0; 0; 0; }
byCoordinates = Geom.XYZ.ByCoordinates(x=code_block_2.out0, y=code_block_2.out1, z=code_block_2.out2)
graphicalContexts = Store.IfcModel.GraphicalContexts(ifcModel=ifc_load)
select_items_from = SelectingItemListNodeModel(items=graphicalContexts, SelectedValue=["Body"])
scene_export_settings = SceneExportSettingsNodeModel(offset=byCoordinates, providedContexts=select_items_from, featureClassificationFilter=canonical_filter, TransformationStrategy=0, PositioningStrategy=0)  # unwired: unitsPerMeter

# group: Save scene model export
directory_path = Directory(".\Out")
scene_export = SceneExporterNodeModel(settings=scene_export_settings, ifcModel=ifc_load, pathName=directory_path, SelectedOption="json", IsCancelable=true)  # unwired: separator

# group: Logging output
log_filter = LogFilterNodeModel(logSource=scene_export, LogCount=10, LogMinSeverity=0)  # unwired: logReason
data_preview = DataTablePreviewNodeModel(in=log_filter, MinCount=1, MaxCount=100, Count=10)
